# Dynamo graph Streaming Minecraft Blocks to Dynamo Sandbox.dyn (Dynamo 2.0.3.8810)

# note: Streaming Minecraft Blocks to Dynamo Sandbox
# Version 0.1
# Coded by Andrew King
# https://andrewkingme.com
# 2019-08-15 Version 0.1
# Hello World
now = DateTime.Now()
player_getpos = Python(IN[0]=now)
# ---------- player_getpos.python (21 lines) ----------
# Python Node for Dynamo
# Minecraft player.getPos()
# Coded by Andrew King
# https://andrewkingme.com

import sys
sys.path.append('C:\Python27\mcpipy')
from mcpi.minecraft import Minecraft

# The inputs to this node will be stored as a list in the IN variables.
dataEnteringNode = IN

mc = Minecraft.create()

playerPos = mc.player.getPos()
playerPosx = int(playerPos.x)
playerPosy = int(playerPos.y)
playerPosz = int(playerPos.z)

# Assign your output to the OUT variable.
OUT = playerPosx, playerPosy, playerPosz
# ----------------------------------------
code_block = CodeBlock { -5..5; }
add = player_getpos + code_block  # lacing=CrossProduct
code_block_2 = CodeBlock { 0; 1; 2; }
getItemAtIndex = List.GetItemAtIndex(list=add, index=code_block_2.out0)
getItemAtIndex_2 = List.GetItemAtIndex(list=add, index=code_block_2.out1)
getItemAtIndex_3 = List.GetItemAtIndex(list=add, index=code_block_2.out2)
getblock = Python(IN[0]=getItemAtIndex, IN[1]=getItemAtIndex_2, IN[2]=getItemAtIndex_3)
# ---------- getblock.python (32 lines) ----------
# Python Node for Dynamo
# Minecraft getBlock()
# Coded by Andrew King
# https://andrewkingme.com

import sys
sys.path.append('C:\Python27\mcpipy')
from mcpi.minecraft import Minecraft

# The inputs to this node will be stored as a list in the IN variables.
inputPosx = IN[0]
inputPosy = IN[1]
inputPosz = IN[2]

blockPosx = []
blockPosy = []
blockPosz = []
blockType = []

mc = Minecraft.create()

for x in inputPosx:
	for y in inputPosy:
		for z in inputPosz:
			blockPosx.append(x)
			blockPosy.append(y)
			blockPosz.append(z)
			blockType.append(mc.getBlock(int(x),int(y),int(z)))
			mc.postToChat(str(x) + ', ' + str(y) + ', ' + str(z))

# Assign your output to the OUT variable.
OUT = blockPosx, blockPosy, blockPosz, blockType
# ----------------------------------------
transpose = List.Transpose(lists=getblock)
code_block_3 = CodeBlock { 3; }
getItemAtIndex_4 = List.GetItemAtIndex(list=transpose@L2, index=code_block_3)
code_block_4 = CodeBlock { 0; }
eq = getItemAtIndex_4 == code_block_4
filterByBoolMask = List.FilterByBoolMask(list=transpose, mask=eq)
code_block_5 = CodeBlock { 0; 1; 2; }
getItemAtIndex_5 = List.GetItemAtIndex(list=filterByBoolMask.out@L2, index=code_block_5.out0)
getItemAtIndex_6 = List.GetItemAtIndex(list=filterByBoolMask.out@L2, index=code_block_5.out2)
getItemAtIndex_7 = List.GetItemAtIndex(list=filterByBoolMask.out@L2, index=code_block_5.out1)
byCoordinates = Point.ByCoordinates(x=getItemAtIndex_5, y=getItemAtIndex_6, z=getItemAtIndex_7)
byLengths = Cuboid.ByLengths(origin=byCoordinates)
